# Grasshopper definition WT_GH-Example.gh (Grasshopper 1.0.8)
# plug-ins: workflow_tools.Components

wt = WT_BuildingSelectorGh(Zone_Index=Slider(2, range=1..4), Plot_Index=Slider(2, range=0..7), Bulding_Index=Slider(2, range=1..10))  # -> Result, Levels, Name, Mass, BoundingBox, Leader
panel = Panel(wt.Result)
