# Grasshopper definition WT_CalculateMetrics.gh (Grasshopper 1.0.8)
# plug-ins: RhinoCodePluginGH

# ---- group: Input
# PROJECT NAME:
# <Project name and code>
# ______________________________________________
# 
# DEFINITION DESCRIPTION:
# <Short description of definition>
data = Data(0)

# ---- group: Control
data_2 = Data(0)

# ---- group: Operation
# REFERENCE FILES:
# <File name>
# 
# 
# ______________________________________________
# 
# SOFTWARE VERSION:
# Grasshopper 1.0.0007
# Rhino 7
# ______________________________________________
# 
# PACKAGES USED:
# <Package name & version>
data_3 = Data(0)

# ---- group: Output
data_4 = Data(0)

# ---- group: IO
data_5 = Data(0)

# ---- group: Check
# AUTHORSHIP:
# <Name - Email>
# 
# ______________________________________________
# 
# REVISION LOG:
# 1.0 | DDMMYY | <Description>
# 
# ______________________________________________
# 
# COMMENTS:
# <notes relating to progress, queries, etc>
data_6 = Data(0)

# ----
equals = EqualityFilter(Key="Layer.Name", Value="BUILDING PADS")  # -> Equal, Unequal

# ---- group: Filter objects from model
objects = QueryModelObjects(Locked=True, Hidden=True, AutoUpdateState=True)
equals_2 = EqualityFilter(Key="Layer.Name", Value="ZONES")  # -> Equal, Unequal
equals_3 = EqualityFilter(Key="Layer.Name", Value="Plots")  # -> Equal, Unequal
equals_4 = EqualityFilter(Key="Layer.Name", Value="DataPts")  # -> Equal, Unequal
intersection = IntersectionFilter(Filters=[equals_2.Unequal, equals_3.Unequal, equals_4.Unequal, equals.Unequal])
filter = FilterContent(Content=objects, Filter=equals_2.Equal)  # -> simplify(graft(Content)), Pass, Count
filter_2 = FilterContent(Content=objects, Filter=equals.Equal)  # -> Content, Pass, Count
filter_3 = FilterContent(Content=objects, Filter=equals_3.Equal)  # -> Content, Pass, Count
filter_4 = FilterContent(Content=objects, Filter=intersection)  # -> Content, Pass, Count

# ----
details = ContentDetails(Content=filter.Content)  # -> Content, Id, Path, Attributes
details_2 = ContentDetails(Content=filter_3.Content)  # -> Content, Id, Path, Attributes
expression = Expression(x=details_2.Path, y=details.Path, Expression="Contains(x, y)")
contains = ContainsTextFilter(Key="Name", Text=details.Path, Case=True, Culture=127, ContainsTextMode=1)
cull = CullPattern(List=details_2.Path, CullPattern=expression)  # -> simplify(List)

# ---- group: Plots grouped per zone
filter_5 = FilterContent(Content=filter_3.Content, Filter=contains)  # -> simplify(graft(Content)), Pass, Count

# ---- group: Model Objects grouped per zone
filter_6 = FilterContent(Content=filter_4.Content, Filter=contains)  # -> simplify(Content), Pass, Count

# ----
filter_7 = FilterContent(Content=filter_2.Content, Filter=contains)  # -> simplify(Content), Pass, Count
contains_2 = ContainsTextFilter(Key="Name", Text=cull, Case=True, Culture=127, ContainsTextMode=1)

# ---- group: Model Objects grouped per Zone / Plot
filter_8 = FilterContent(Content=simplify(filter_6.Content), Filter=contains_2)  # -> simplify(Content), Pass, Count

# ---- group: Building Pads / Zone / Plot
filter_9 = FilterContent(Content=simplify(filter_7.Content), Filter=contains_2)  # -> simplify(Content), Pass, Count

# ----
group = GroupContent(Content=filter_9.Content, Key="Name")  # -> simplify(Content), Values
# {ZONE; PLOT; BLDG}(OBJECTS)
group_2 = GroupContent(Content=filter_8.Content, Key="Name")  # -> simplify(Content), Values

# ----
# {ZONE}(OBJECTS)
# {ZONE; PLOT}(OBJECTS)
bldg_zone = Data(filter_6.Content)
pads = Data(group.Content)
bldg = Data(group_2.Content)
# {ZONE}
zones = Data(filter.Content)
# {ZONE; PLOT}
plots = Data(filter_5.Content)
objects_2 = Data(filter_8.Content)

# ---- group: Calculate zones areas
area = Area(Geometry=zones)  # -> Area, graft(Centroid)
round = Round(Number=area.Area)  # -> Nearest, Floor, Ceiling

# ----
panel = Panel(area.Area)

# ---- group: Calculate plot areas
area_2 = Area(Geometry=plots)  # -> Area, graft(Centroid)
round_2 = Round(Number=area_2.Area)  # -> Nearest, Floor, Ceiling

# ---- group: Calculate floor areas
md_slider = MDSlider(SliderMode=0, slider_value=Point(0.5, 0.5, 0.5), x_domain=Domain(0, 1), y_domain=Domain(0, 1), z_domain=Domain(0, 1))
debrep = DeconstructBrep(Brep=bldg)  # -> Faces, Edges, Vertices
evalsrf = EvaluateSurface(Surface=reparameterize(debrep.Faces), Point=md_slider)  # -> Point, Normal, UDirection, VDirection, Frame
pdecon = Deconstruct(Point=evalsrf.Point)  # -> XComponent, YComponent, ZComponent
sort = SortList(Keys=pdecon.ZComponent, ValuesA=debrep.Faces)  # -> Keys, ValuesA
item = ListItem(List=sort.ValuesA, Index=0, Wrap=True)
area_3 = Area(Geometry=item)  # -> Area, Centroid
round_3 = Round(Number=area_3.Area)  # -> Nearest, Floor, Ceiling

# ----
zone_totalgfa = Data(round.Nearest)
plot_totalgfa = Data(round_2.Nearest)

# ---- group: Give each building element it's GFA
u_text = UserText(Content=graft(bldg), Keys="GFA", Values=round_3.Nearest, UserTextMode=1)  # -> Content, Keys, Values

# ----
pshift = ShiftPaths(Data=u_text.Content, Offset=-1)
pshift_2 = ShiftPaths(Data=pshift, Offset=-1)
pshift_3 = ShiftPaths(Data=pshift_2, Offset=-1)
group_3 = GroupContent(Content=pshift_2, Key="Layer.Name")  # -> simplify(Content), simplify(Values)
group_4 = GroupContent(Content=pshift_3, Key="Layer.Name")  # -> simplify(Content), simplify(Values)
group_5 = GroupContent(Content=pshift, Key="Layer.Name")  # -> simplify(Content), simplify(Values)

# ---- group: Extract GFA
u_text_2 = UserText(Content=group_4.Content, Keys="GFA", UserTextMode=1)  # -> Content, Keys, Values
u_text_3 = UserText(Content=group_3.Content, Keys="GFA", UserTextMode=1)  # -> Content, Keys, Values
u_text_4 = UserText(Content=group_5.Content, Keys="GFA", UserTextMode=1)  # -> Content, Keys, Values

# ----
pshift_4 = ShiftPaths(Data=u_text_2.Values, Offset=-1)
pshift_5 = ShiftPaths(Data=u_text_3.Values, Offset=-1)
pshift_6 = ShiftPaths(Data=u_text_4.Values, Offset=-1)
pshift_7 = ShiftPaths(Data=pshift_6, Offset=-1)
pshift_8 = ShiftPaths(Data=pshift_7, Offset=-1)
pshift_9 = ShiftPaths(Data=pshift_8, Offset=-1)
ma = MassAddition(Input=pshift_4)  # -> Result, PartialResults
ma_2 = MassAddition(Input=pshift_5)  # -> Result, PartialResults
ma_3 = MassAddition(Input=pshift_6)  # -> Result, PartialResults
ma_4 = MassAddition(Input=pshift_7)  # -> Result, PartialResults
ma_5 = MassAddition(Input=pshift_8)  # -> Result, PartialResults
ma_6 = MassAddition(Input=pshift_9)  # -> Result, PartialResults
weave = Weave(Pattern=[0, 1], Stream0=graft(group_3.Values), Stream1=ma_2.Result, NullGaps=False)
join = TextJoin(Text=group_3.Values, Join=", ")  # -> simplify(Result)
weave_2 = Weave(Pattern=[0, 1], Stream0=graft(group_5.Values), Stream1=ma_3.Result, NullGaps=False)
join_2 = TextJoin(Text=group_5.Values, Join=", ")
division = Division(A=plot_totalgfa, B=ma_5.Result)
division_2 = Division(A=zone_totalgfa, B=ma_6.Result)
weave_3 = Weave(Pattern=[0, 1], Stream0=graft(group_4.Values), Stream1=ma.Result, NullGaps=False)
join_3 = TextJoin(Text=group_4.Values, Join=", ")  # -> simplify(Result)
c_script = CSharpScript(x=division_2)  # -> out, simplify(a); inputs x: Double
# ---------- c_script: C# ----------
// Grasshopper Script Instance
#region Usings
using System;
using System.Linq;
using System.Collections;
using System.Collections.Generic;
using System.Drawing;

using Rhino;
using Rhino.Geometry;

using Grasshopper;
using Grasshopper.Kernel;
using Grasshopper.Kernel.Data;
using Grasshopper.Kernel.Types;
#endregion

public class Script_Instance : GH_ScriptInstance
{
    #region Notes
    /* 
      Members:
        RhinoDoc RhinoDocument
        GH_Document GrasshopperDocument
        IGH_Component Component
        int Iteration

      Methods (Virtual & overridable):
        Print(string text)
        Print(string format, params object[] args)
        Reflect(object obj)
        Reflect(object obj, string method_name)
    */
    #endregion

    private void RunScript(double x, ref object a)
    {
        // Write your logic here

        a = System.Math.Round(x, 2);
    }
}
# ---------- end c_script ----------
join_4 = TextJoin(Text=weave, Join=":")
join_5 = TextJoin(Text=weave_2, Join=":")
c_script_2 = CSharpScript(x=division)  # -> out, simplify(a); inputs x: Double; same code as c_script
join_6 = TextJoin(Text=weave_3, Join=":")
pshift_10 = ShiftPaths(Data=join_4, Offset=-1)
pshift_11 = ShiftPaths(Data=join_5, Offset=-1)
pshift_12 = ShiftPaths(Data=join_6, Offset=-1)
join_7 = TextJoin(Text=pshift_11, Join=", ")  # -> simplify(Result)
join_8 = TextJoin(Text=pshift_10, Join=", ")  # -> simplify(Result)
join_9 = TextJoin(Text=pshift_12, Join=", ")  # -> simplify(Result)
panel_2 = Panel("""Building
Open space""")
lng = ListLength(List=bldg)
building_nlevels = Data(lng)
zone_landusesgfa = Data(join_9)
zone_landuses = Data(join_3)
plot_landusesgfa = Data(join_8)
plot_landuses = Data(join)
building_landusesgfa = Data(join_7)
tmatch = MatchText(Text=building_landusesgfa, Pattern="*open space*", Case=False)
int = Integer(tmatch)
item_2 = ListItem(List=panel_2, Index=int, Wrap=True)  # -> simplify(Item)
building_landuses = Data(join_2)
building_totalgfa = Data(ma_4.Result)

plot_builtgfa = Data(ma_5.Result)
plot_ratio = Data(c_script_2.a)

zone_builtgfa = Data(ma_6.Result)
zone_ratio = Data(c_script.a)

building_type = Data(item_2)
lng_2 = ListLength(List=zone_landuses)
lng_3 = ListLength(List=plot_landuses)
repeat = RepeatData(Data="Zone", Length=lng_2)  # -> simplify(Data)
repeat_2 = RepeatData(Data="Plot", Length=lng_3)  # -> simplify(Data)
zone_type = Data(repeat)
plot_type = Data(repeat_2)
zone_keys = Panel("""Type
TotalGFA
BuiltGFA
Ratio
Landuses
LanduseGFA""")

zone_landuses_2 = Data(zone_landuses)
zone_landusesgfa_2 = Data(zone_landusesgfa)
zone_totalgfa_2 = Data(zone_totalgfa)
zone_builtgfa_2 = Data(zone_builtgfa)
zone_type_2 = Data(zone_type)
zone_ratio_2 = Data(zone_ratio)

plot_landuses_2 = Data(plot_landuses)
plot_landusesgfa_2 = Data(plot_landusesgfa)
plot_type_2 = Data(plot_type)
plot_builtgfa_2 = Data(plot_builtgfa)
plot_ratio_2 = Data(plot_ratio)
plot_totalgfa_2 = Data(plot_totalgfa)

building_landuses_2 = Data(building_landuses)
building_nlevels_2 = Data(building_nlevels)
building_landusegfa = Data(building_landusesgfa)
building_type_2 = Data(building_type)
building_totalgfa_2 = Data(building_totalgfa)

building_keys = Panel("""Type
TotalGFA
NLevels
Landuses
LanduseGFA""")
plot_keys = Panel("""Type
TotalGFA
BuiltGFA
Ratio
Landuses
LanduseGFA""")
merge = Merge(
    Data1=zone_type_2,
    Data2=zone_totalgfa_2,
    Data3=zone_builtgfa_2,
    Data4=zone_ratio_2,
    Data5=zone_landuses_2,
    Data6=zone_landusesgfa_2)
merge_2 = Merge(
    Data1=plot_type_2,
    Data2=plot_totalgfa_2,
    Data3=plot_builtgfa_2,
    Data4=plot_ratio_2,
    Data5=plot_landuses_2,
    Data6=plot_landusesgfa_2)
merge_3 = Merge(
    Data1=building_type_2,
    Data2=building_totalgfa_2,
    Data3=building_nlevels_2,
    Data4=building_landuses_2,
    Data5=building_landusegfa)
u_text_5 = UserText(Content=pads, Keys=building_keys, Values=merge_3, UserTextMode=1)  # -> Content, Keys, Values
u_text_6 = UserText(Content=zones, Keys=zone_keys, Values=merge, UserTextMode=1)  # -> Content, Keys, Values
u_text_7 = UserText(Content=plots, Keys=plot_keys, Values=merge_2, UserTextMode=1)  # -> Content, Keys, Values
merge_4 = Merge(Data1=u_text_6.Content, Data2=u_text_7.Content, Data3=u_text_5.Content)
action = Action({"Purge", "Pull", "Push", "Bake"}, selected="Push")
cache = ContentCache(Name="metrics", Content=merge_4, Action=action)  # -> Name, Content, Result
context_print = ContextPrint(Text="Calculate Metrics")
