# Grasshopper definition WT_ExportToCSV.gh (Grasshopper 1.0.8)
# plug-ins: RhinoCodePluginGH

hatch = Hatch([<hatch referenced from the Rhino model> x4])
get_geometry = GetGeometry(
    hatch,
    AnnotationTypeFilter=0,
    AtLeast=1,
    AtMost=1000,
    DeleteInput=False,
    Filter=65536,
    Prompt="Select hatches to include in csv export",
    TreeAccess=False)
c_script = CSharpScript()  # -> out, fileName
# ---------- c_script: C# ----------
// Grasshopper Script Instance
#region Usings
using System;
using System.Linq;
using System.Collections;
using System.Collections.Generic;
using System.Drawing;

using Rhino;
using Rhino.Geometry;

using Grasshopper;
using Grasshopper.Kernel;
using Grasshopper.Kernel.Data;
using Grasshopper.Kernel.Types;
#endregion

public class Script_Instance : GH_ScriptInstance
{
    #region Notes
    /* 
      Members:
        RhinoDoc RhinoDocument
        GH_Document GrasshopperDocument
        IGH_Component Component
        int Iteration

      Methods (Virtual & overridable):
        Print(string text)
        Print(string format, params object[] args)
        Reflect(object obj)
        Reflect(object obj, string method_name)
    */
    #endregion

    private void RunScript(object run, ref object fileName)
    {
        var sfd = new Rhino.UI.SaveFileDialog();
        sfd.Title = "Select directory and filename for the csv export.";
        sfd.DefaultExt = ".csv";
        sfd.Filter = ".csv";
        sfd.FileName = ".csv";
        var rc = sfd.ShowSaveDialog();
        fileName = sfd.FileName;
    }
}
# ---------- end c_script ----------

# ---- group: FindElementsInBoundery
script = Script(SearchArea=get_geometry)  # -> GeometryNames, HostedGeometry; inputs SearchArea: GeometryBase
# ---------- script: Python ----------
import Rhino

def is_point_in_hatch_boundary(hatch_boundary, point):
    # Get the boundary curves of the hatch
    boundary_curves = hatch_boundary.Get3dCurves(True)
    # For each boundary curve, check if the point is inside
    for curve in boundary_curves:
        # Try to get the plane of the curve
        rc, plane = curve.TryGetPlane()
        if not rc:
            continue  # Skip if the plane cannot be determined
        containment = curve.Contains(point, plane, 0.01)
        if containment in (Rhino.Geometry.PointContainment.Inside, Rhino.Geometry.PointContainment.Coincident):
            return True
    return False

# Compute the area of the 'SearchArea' hatch
search_area_mass_props = Rhino.Geometry.AreaMassProperties.Compute(SearchArea)
if search_area_mass_props is None:
    raise Exception("Could not compute area of the SearchArea hatch.")
search_area_area = search_area_mass_props.Area

# Initialize empty lists to store geometries and their names within the hatch boundary
HostedGeometry = []
GeometryNames = []

# Define a small tolerance for area comparison
area_tolerance = 0.0001  # Adjust this value based on your units and precision

# Iterate through each object in the active Rhino document
for obj in Rhino.RhinoDoc.ActiveDoc.Objects:
    # Only process hatch objects
    if isinstance(obj.Geometry, Rhino.Geometry.Hatch):
        geom = obj.Geometry

        # Compute the area of the hatch
        hatch_mass_props = Rhino.Geometry.AreaMassProperties.Compute(geom)
        if hatch_mass_props is None:
            continue  # Skip if area cannot be computed
        hatch_area = hatch_mass_props.Area

        # Exclude the input hatch by comparing areas within a tolerance
        area_difference = abs(hatch_area - search_area_area)
        if area_difference < area_tolerance:
            continue  # Skip the input hatch (and any hatch with the same area)

        # Get the center of the object's bounding box
        bbox = geom.GetBoundingBox(True)
        center_point = bbox.Center

        # Check if the center point is within the hatch boundary
        if is_point_in_hatch_boundary(SearchArea, center_point):
            HostedGeometry.append(geom)
            # Get the object's name or assign a default name
            obj_name = obj.Name if obj.Name else "Unnamed Object"
            GeometryNames.append(obj_name)

# Assign the outputs in the Grasshopper Python component
# Replace 'a' and 'b' with your output parameter names if you have renamed them
a = HostedGeometry
b = GeometryNames
# ---------- end script ----------

script_2 = Script(SearchArea=script.HostedGeometry)  # -> GeometryNames; inputs SearchArea: GeometryBase
# ---------- script_2: Python ----------
import Rhino
import Rhino.Geometry as rg

def is_point_in_boundary(boundary_curves, point):
    # Check if the point is inside any of the boundary curves
    for curve in boundary_curves:
        rc, plane = curve.TryGetPlane()
        if not rc:
            continue  # Skip if the plane cannot be determined
        containment = curve.Contains(point, plane, 0.01)
        if containment in (rg.PointContainment.Inside, rg.PointContainment.Coincident):
            return True
    return False

def bounding_boxes_intersect(bbox1, bbox2):
    # Check if bounding boxes intersect by comparing min and max coordinates
    return (bbox1.Min.X <= bbox2.Max.X and bbox1.Max.X >= bbox2.Min.X) and \
           (bbox1.Min.Y <= bbox2.Max.Y and bbox1.Max.Y >= bbox2.Min.Y) and \
           (bbox1.Min.Z <= bbox2.Max.Z and bbox1.Max.Z >= bbox2.Min.Z)

# If SearchArea is empty, set up an empty boundary_curves list
boundary_curves = []

# Determine boundary curves for the SearchArea if it's not empty
if SearchArea:
    if isinstance(SearchArea, rg.Hatch):
        boundary_curves = SearchArea.Get3dCurves(True)  # Get outer boundary curves for hatches
    elif isinstance(SearchArea, rg.Curve):
        boundary_curves = [SearchArea]  # Use the curve directly

# Initialize the list to store names within the boundary
GeometryNames = []

# Only proceed if boundary_curves is not empty
if boundary_curves:
    # Get the bounding box of the SearchArea
    search_area_bbox = SearchArea.GetBoundingBox(True)

    # Iterate through each object in the active Rhino document
    for obj in Rhino.RhinoDoc.ActiveDoc.Objects:
        # Process both Hatch and Curve objects
        if isinstance(obj.Geometry, (rg.Hatch, rg.Curve)):
            geom = obj.Geometry
            # Quickly check if the bounding boxes intersect
            obj_bbox = geom.GetBoundingBox(True)
            if not bounding_boxes_intersect(search_area_bbox, obj_bbox):
                continue  # Skip objects whose bounding boxes do not intersect

            # Get the center of the object's bounding box
            center_point = obj_bbox.Center

            # Check if the center point is within the boundary
            if is_point_in_boundary(boundary_curves, center_point):
                # Get the object's name or assign a default name
                obj_name = obj.Attributes.Name if obj.Attributes.Name else "Unnamed Object"
                GeometryNames.append(obj_name)

# Assign the output in the Grasshopper Python component
a = GeometryNames
# ---------- end script_2 ----------

# ---- group: QueryElementsByName
python_3_script = Python3Script(GeometryName=script_2)  # -> Geometry; inputs GeometryName: list of String
# ---------- python_3_script: Python ----------
import Rhino

# Ensure GeometryName is a list and remove duplicates
if not isinstance(GeometryName, list):
    GeometryName = [GeometryName]
UniqueNames = list(set(GeometryName))

# Initialize an empty list to store curves with the specified names
FoundGeometry = []

# Iterate through each object in the active Rhino document
for obj in Rhino.RhinoDoc.ActiveDoc.Objects:
    # Check if the object's name matches any of the unique names
    if obj.Attributes.Name in UniqueNames:
        # Check if the object's geometry is a Curve
        if isinstance(obj.Geometry, Rhino.Geometry.Curve):
            # Add the curve's geometry to the list
            FoundGeometry.append(obj.Geometry)

# Assign the output in the Grasshopper Python component
Geometry = FoundGeometry
# ---------- end python_3_script ----------

# ---- group: FindElementsInBoundery
script_3 = Script(SearchArea=python_3_script)  # -> GeometryNames; inputs SearchArea: GeometryBase; same code as script_2

python_3_script_2 = Python3Script(GeometryName=script_3)  # -> Geometry, Layers; inputs GeometryName: list of String
# ---------- python_3_script_2: Python ----------
import Rhino
import Rhino.Geometry as rg

# Ensure GeometryName is a list and remove duplicates
if not isinstance(GeometryName, list):
    GeometryName = [GeometryName]
UniqueNames = list(set(GeometryName))

# Initialize lists to store geometries, layers, and profiles
FoundGeometry = []
GeometryLayers = []


# Iterate through each object in the active Rhino document
for obj in Rhino.RhinoDoc.ActiveDoc.Objects:
    # Check if the object's name matches any of the unique names
    if obj.Attributes.Name in UniqueNames:
        geometry = obj.Geometry

        # Check if the geometry is an Extrusion
        if isinstance(geometry, rg.Extrusion):
            FoundGeometry.append(geometry)
            
            # Get the layer name
            layer_index = obj.Attributes.LayerIndex
            layer = Rhino.RhinoDoc.ActiveDoc.Layers[layer_index].FullPath
            GeometryLayers.append(layer)



# Assign the outputs in the Grasshopper Python component
Geometry = FoundGeometry
Layers = GeometryLayers
# ---------- end python_3_script_2 ----------

# ---- group: GetBuildingInfo
python_3_script_3 = Python3Script(footprint=graft(python_3_script), Buildings=python_3_script_2.Geometry)  # -> Area, FloorCount; inputs footprint: GeometryBase, Buildings: list of GeometryBase
# ---------- python_3_script_3: Python ----------
import Rhino.Geometry as rg

# Initialize area and floors with default values
area = None
floors = 1

# Check if 'footprint' is provided and is a closed polyline curve
if footprint and isinstance(footprint, rg.PolylineCurve) and footprint.IsClosed:
    # Compute the area of the closed curve
    area_properties = rg.AreaMassProperties.Compute(footprint)
    area = area_properties.Area if area_properties else None

# Check if 'Buildings' is a valid list and get the count as 'floors'
if isinstance(Buildings, list):
    floors = len(Buildings)

# Calculate the total area if area is valid
total_area = area * floors if area is not None else None

# Round the total area to the nearest decimal
rounded_total_area = round(total_area, 1) if total_area is not None else None

# Output the rounded total area in the Grasshopper Python component
Area = rounded_total_area
FloorCount = floors
# ---------- end python_3_script_3 ----------

# ---- group: GetLandUse
python_3_script_4 = Python3Script(Plot=graft(script.HostedGeometry), Buildings=python_3_script)  # -> LandUse; inputs Plot: list of GeometryBase, Buildings: list of GeometryBase
# ---------- python_3_script_4: Python ----------
import Rhino.Geometry as rg

# Initialize total area variables for plots and buildings
total_plot_area = 0
total_building_area = 0

# Check if 'Plot' input is provided and contains hatches or curves
if Plot:
    for item in Plot:
        if isinstance(item, rg.Hatch):
            # Calculate area for hatches
            area_properties = rg.AreaMassProperties.Compute(item)
            if area_properties:
                total_plot_area += area_properties.Area
        elif isinstance(item, rg.Curve) and item.IsClosed:
            # Calculate area for closed curves
            area_properties = rg.AreaMassProperties.Compute(item)
            if area_properties:
                total_plot_area += area_properties.Area

# Check if 'Buildings' input is provided and contains hatches or curves
if Buildings:
    for item in Buildings:
        if isinstance(item, rg.Hatch):
            # Calculate area for hatches
            area_properties = rg.AreaMassProperties.Compute(item)
            if area_properties:
                total_building_area += area_properties.Area
        elif isinstance(item, rg.Curve) and item.IsClosed:
            # Calculate area for closed curves
            area_properties = rg.AreaMassProperties.Compute(item)
            if area_properties:
                total_building_area += area_properties.Area

# Calculate Land Use ratio
land_use = total_building_area / total_plot_area if total_plot_area > 0 else None

# Output the total areas and land use ratio
PlotArea = round(total_plot_area, 2)
BuildingArea = round(total_building_area, 2)
LandUse = round(land_use, 2) if land_use is not None else None
# ---------- end python_3_script_4 ----------

# ----
data = Data(simplify(graft(script.GeometryNames)))
data_2 = Data(simplify(python_3_script_4))
data_3 = Data(simplify(python_3_script_3.Area))
data_4 = Data(simplify(python_3_script_3.FloorCount))
data_5 = Data(simplify(python_3_script_2.Layers))
create_set = CreateSet(List=data_5)  # -> simplify(Set), Map
text_join = TextJoin(Text=create_set.Set)
shift_paths = ShiftPaths(Data=data_3, Offset=-1)
shift_paths_2 = ShiftPaths(Data=data_4, Offset=-1)
shift_paths_3 = ShiftPaths(Data=text_join, Offset=-1)
list_length = ListLength(List=shift_paths)
repeat_data = RepeatData(Data=data, Length=list_length)  # -> simplify(Data)
repeat_data_2 = RepeatData(Data=data_2, Length=list_length)  # -> simplify(Data)

# ---- group: ExportCSV
python_3_script_5 = Python3Script(
    PlotName=flatten(repeat_data),
    Ratio=flatten(repeat_data_2),
    FloreArea=flatten(shift_paths),
    FloreCount=flatten(shift_paths_2),
    UseCase=flatten(shift_paths_3),
    Path=c_script.fileName)  # -> a; inputs PlotName: list, Ratio: list, FloreArea: list, FloreCount: list, UseCase: list
# ---------- python_3_script_5: Python ----------
#! python3
# r: polars

import polars as pl
import os

# Define your Path variable with the desired filename
# Example: Path = "output.csv" (only filename) or Path = "/desired/path/output.csv"

# Check if Path is a filename without a directory
if not os.path.dirname(Path):  
    # Use the directory of the Grasshopper file if only a filename is provided
    Path = os.path.join(os.getcwd(), Path)

# Check if the directory exists, and create it if it doesn’t
directory = os.path.dirname(Path)
if not os.path.exists(directory):
    os.makedirs(directory)

# Prepare the data as a dictionary for easy DataFrame creation
data_dict = {
    "PlotName": PlotName,
    "Ratio": Ratio,
    "FloreArea": FloreArea,
    "FloreCount": FloreCount,
    "UseCase": UseCase
}

# Create a DataFrame with polars
df = pl.DataFrame(data_dict)

# Save the DataFrame to CSV
df.write_csv(Path)

# Output a message or confirmation if needed
print(f"CSV file created at: {Path}")
# ---------- end python_3_script_5 ----------
