# Grasshopper definition WT_ExportToXLSX_2.gh (Grasshopper 1.0.8)
# plug-ins: RhinoCodePluginGH

c_script = CSharpScript()  # -> out, fileName
# ---------- c_script: C# ----------
// Grasshopper Script Instance
#region Usings
using System;
using System.Linq;
using System.Collections;
using System.Collections.Generic;
using System.Drawing;

using Rhino;
using Rhino.Geometry;

using Grasshopper;
using Grasshopper.Kernel;
using Grasshopper.Kernel.Data;
using Grasshopper.Kernel.Types;
#endregion

public class Script_Instance : GH_ScriptInstance
{
    #region Notes
    /* 
      Members:
        RhinoDoc RhinoDocument
        GH_Document GrasshopperDocument
        IGH_Component Component
        int Iteration

      Methods (Virtual & overridable):
        Print(string text)
        Print(string format, params object[] args)
        Reflect(object obj)
        Reflect(object obj, string method_name)
    */
    #endregion

    private void RunScript(object run, ref object fileName)
    {
        var sfd = new Rhino.UI.SaveFileDialog();
        sfd.Title = "Select directory and filename for the xlsx export.";
        sfd.DefaultExt = ".xlsx";
        sfd.Filter = ".xlsx";
        sfd.FileName = ".xlsx";
        var rc = sfd.ShowSaveDialog();
        fileName = sfd.FileName;
    }
}
# ---------- end c_script ----------

# ---- group: Retrive Plots From Document
python_3_script = Python3Script(layer_name="PLOTS")  # -> geometry, names, key_value_strings; inputs layer_name: String
# ---------- python_3_script: Python ----------
import Rhino

doc = Rhino.RhinoDoc.ActiveDoc

# Find the layer by name
layer = doc.Layers.FindName(layer_name)

# Get object IDs on the specified layer
obj_ids = [obj.Id for obj in doc.Objects if obj.Attributes.LayerIndex == layer.Index]

# Initialize lists to store data
geometry = []
names = []
key_value_strings = []

# Loop through each object ID
for id in obj_ids:
    obj = doc.Objects.Find(id)
    # Duplicate the geometry
    geom = obj.Geometry.Duplicate()
    geometry.append(geom)
    # Get the object's name
    names.append(obj.Name)
    # Get user strings (key-value pairs) and convert them to strings
    user_strings = obj.Attributes.GetUserStrings()
    if user_strings.Count > 0:
        # Create a string representation of the key-value pairs
        kv_pairs = [f"{key}: {user_strings[key]}" for key in user_strings.AllKeys]
        kv_str = "; ".join(kv_pairs)
        key_value_strings.append(kv_str)
    else:
        key_value_strings.append("")
# ---------- end python_3_script ----------

# ---- group: Plots
data = Data(python_3_script.geometry)

# ---- group: Create Data Table
python_3_script_2 = Python3Script(plotName=python_3_script.names, data_strings=python_3_script.key_value_strings, file_path=c_script.fileName)  # -> success; inputs plotName: list, data_strings: list of String, file_path: String
# ---------- python_3_script_2: Python ----------
# venv: rhino
# r: openpyxl

import os
from collections import defaultdict
from openpyxl import Workbook

def parse_data_strings(data_strings, plot_names):
    data_list = []
    for data_str, plot_name in zip(data_strings, plot_names):
        data_dict = {}
        data_dict['PlotName'] = plot_name
        pairs = [pair.strip() for pair in data_str.split(';')]
        for pair in pairs:
            if ': ' in pair:
                key, value = pair.split(': ', 1)
                key = key.strip()
                value = value.strip()
                if key == 'LanduseGFA':
                    # Parse nested key-value pairs
                    landuse_pairs = [lv.strip() for lv in value.split(',')]
                    for landuse_pair in landuse_pairs:
                        if ':' in landuse_pair:
                            lu_key, lu_value = landuse_pair.split(':', 1)
                            lu_key = f"{key}_{lu_key.strip()}"
                            lu_value = lu_value.strip()
                            data_dict[lu_key] = lu_value
                else:
                    data_dict[key] = value
        data_list.append(data_dict)
    return data_list

# Parse the data strings and combine with plot names
data_list = parse_data_strings(data_strings, plotName)

# Group data by the first character of PlotName
data_groups = defaultdict(list)
for data in data_list:
    plot_name = data.get('PlotName', '')
    if plot_name:
        group_key = plot_name[0]  # First character
        data_groups[group_key].append(data)

# Create a new Excel workbook
wb = Workbook()
# Remove the default sheet
default_sheet = wb.active
wb.remove(default_sheet)

# Sort the group keys numerically
sorted_group_keys = sorted(data_groups.keys(), key=int)

# For each group, create a sheet and write data
for group_key in sorted_group_keys:
    group_data = data_groups[group_key]
    ws = wb.create_sheet(title=f"Zone_{group_key}")
    # Get all headers
    headers = set()
    for data in group_data:
        headers.update(data.keys())
    headers = sorted(headers)
    # Write headers
    ws.append(headers)
    # Write data rows
    for data in group_data:
        row = [data.get(header, '') for header in headers]
        ws.append(row)

# Ensure the directory exists
directory = os.path.dirname(file_path)
if directory and not os.path.exists(directory):
    os.makedirs(directory)

# Ensure the file has the correct extension
if not file_path.lower().endswith('.xlsx'):
    file_path += '.xlsx'

# Save the workbook
wb.save(file_path)
success = True
# ---------- end python_3_script_2 ----------

# ----
panel = Panel(python_3_script_2)
