# Grasshopper definition hello_world.gh (Grasshopper 1.0.8)

get_name = GetString("Acadia", AtLeast=1, AtMost=1, Prompt="Please enter your name...", TreeAccess=False)
concat = Concatenate(FragmentA="Hello ", FragmentB=get_name, FragmentC="!")
context_print = ContextPrint(Text=concat)
