# Grasshopper definition WT_BuildingSelector.gh (Grasshopper 1.0.8)

plot_index = GetInteger(Slider(4, range=0..25), AtLeast=1, AtMost=1, Maximum=2147483647, Minimum=-2147483648, TreeAccess=False)
charseq = CharSequence(Count="26", CharPool="ABCDEFGHIJKLMNOPQRSTUVWXYZ", Format="{0}")
bulding_index = GetInteger(Slider(5, range=0..25), AtLeast=1, AtMost=1, Maximum=2147483647, Minimum=-2147483648, TreeAccess=False)
zone_index = GetInteger(Slider(1, range=1..4), AtLeast=1, AtMost=1, Maximum=2147483647, Minimum=-2147483648, TreeAccess=False)
item = ListItem(List=charseq, Index=plot_index, Wrap=invert(True))
concat = Concatenate(FragmentA=zone_index, FragmentB="-", FragmentC=item, FragmentD=".", FragmentE=bulding_index)
objects = QueryModelObjects(Name=concat, Locked=True, Hidden=True, AutoUpdateState=True)
equals = EqualityFilter(Value="Extrusion")  # -> Equal, Unequal
filter = FilterContent(Content=objects, Filter=equals.Equal)
object = ModelObject(Object=filter)  # -> Object, Geometry, Name, Layer, Visibility, Display, Drafting, Render
lng = ListLength(List=object.Object)
null = NullItem(Item=object.Object)  # -> NullFlags, InvalidFlags, Description
item_2 = ListItem(List=object.Name, Index=0, Wrap=True)
concat_2 = Concatenate(
    FragmentA="Building ",
    FragmentB=item_2,
    FragmentC=" ",
    FragmentD="has ",
    FragmentF=lng,
    FragmentE=" ",
    FragmentG="levels.")
bbox = BoundingBox(Content=object.Object, Plane=PlaneXY(0, 0, 0), UnionBox=True)  # -> Box, Box_2
sunion = SolidUnion(Breps=object.Object)
panel = Panel(concat_2)
ma = MassAddition(Input=null.NullFlags)  # -> Result, PartialResults
box = EvaluateBox(Box=bbox.Box, UParameter=0.5, VParameter=0.5, WParameter="1")  # -> Plane, Point, Include
not = GateNot(A=ma.Result)
bool = Boolean(ma.Result)
line = LineSDL(Start=box.Point, Direction=Vector(0, 0, 1), Length="100")
merge = Merge(Data1=flatten("Index out of range"), Data2=flatten(panel))
merge_2 = Merge(Data1=bool, Data2=not)
dispatch = Dispatch(List=merge, DispatchPattern=merge_2)  # -> ListA, ListB
leader = Leader(Curve=line, Text=item_2)  # -> Leader, Plane, Curve, Text
context_bake = ContextBake(BoundingBox=bbox.Box)
context_bake_2 = ContextBake(Content=leader.Leader)
context_print = ContextPrint(Levels=lng)
context_print_2 = ContextPrint(Result=dispatch.ListA)
context_print_3 = ContextPrint(Text=item_2)
context_bake_3 = ContextBake(Content=sunion)
